# Grasshopper definition AxidrawGH_example_2024aug8.gh (Grasshopper 1.0.7)
# plug-ins: AxiDrawGH

# ----
# The Axidraw Control component will automatically unpreview the component plugged into the "Paper Rectangle" input when creating the SVG, and re-preview it after. It does this because it will draw anything in the viewport that is at least partly within the Paper Rectangle.
plane = Plane(PlaneXY(0, 0, 0))
rectangle = Rectangle(Plane=plane, XSize=Domain(0, 14), YSize=Domain(0, 11), Radius=0)  # -> Rectangle, Length

pen_down_move_speed = Slider(78, range=0..111)
pen_up_move_speed = Slider(73, range=0..100)
do_not_include_svg = Panel("viewCap_test2")
acceleration = Slider(62, range=0..101)
pen_raise = Slider(100, range=1..100)
pen_lower = Slider(50, range=1..100)
constant_speed = BooleanToggle(False)
reordering = BooleanToggle(True)
run = Button()

# ---- group: Right click --> Select One Existing File (your axidraw config)
file_path = FilePath("D:\AxiDraw\Axicli stuff\examples_config\axidraw_conf_copy.py")

# ---- group: Right click --> Select A Directory (where you want to save the .svg to)
file_path_2 = FilePath("D:\AxiDraw\Plots\")

# ----
axidraw_control = AxiDrawControl(
    Config=file_path,
    Filepath=file_path_2,
    Name=do_not_include_svg,
    Run=run,
    PaperRectangle=rectangle.Rectangle,
    DrawSpeed=pen_down_move_speed,
    MoveSpeed=pen_up_move_speed,
    Acceleration=acceleration,
    LoweringRate=pen_lower,
    RaisingRate=pen_raise,
    ConstSpeed=constant_speed,
    Reorder=reordering)

# ---- group: It will draw all of this stuff. anything that is at least partly contained in the Paper Rectangle. no need to bake.
offset_curve = OffsetCurve(Curve=rectangle.Rectangle, Distance=-1, Corners=1)
curve = Curve([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])

# ---- group: It will draw all of this stuff. anything that is at least partly contained in the Paper Rectangle. no need to bake. / be warned: it will even draw this. because its partly contained
curve_2 = Curve(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)

# ----
command_sent_to_axicli = Panel(axidraw_control)
